# Grasshopper definition image_encoding.gh (Grasshopper 1.0.8)
# plug-ins: Imaging Library, RhinoCodePluginGH, ClimateStudioGH, Pufferfish, ShapeDiverForGrasshopper

sddp = ShapeDiverDocumentPayload({AbsoluteTolerance=0, AngleTolerance=0, DistanceDisplayPrecision=0, GltfVersion="Gltf2", GrasshopperVersion="1.0.0008", InputGroups="{}", OutputGroups="{}", RelativeTolerance=0, RhinoVersion="8.10.24228.13001", UnitSystem=0, VersionCreated="1.20.0.0", VersionSaved="1.20.0.0"})

# ----
# identifying directory
python_3_script = Python3Script()  # -> out, a
# ---------- python_3_script: Python ----------
import os

# Get the full path of the current Grasshopper document
gh_path = ghenv.Component.OnPingDocument().FilePath

# Check if the file path exists (if the Grasshopper document has been saved)
if gh_path:
    # Get the directory containing the Grasshopper file
    file_directory = os.path.dirname(gh_path)
    a = file_directory
else:
    a = "The Grasshopper file has not been saved yet."
# ---------- end python_3_script ----------
panel = Panel(python_3_script.a)

parent_folder_directory = Panel(panel)
concatenate = Concatenate(FragmentA=panel, FragmentB="\EPW\AZE_ARR_Goychay.377490_TMYx.2007-2021.epw")
concatenate_2 = Concatenate(FragmentA=panel, FragmentB="\CS\sample_sim.csr")

window_nische = Brep(flatten([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]))
window_vector = Vector(flatten([Vector(14.05456228, -1.995965561, 0.61), Vector(13.77483365, -1.954109924, 0.61), Vector(14.05456228, -1.995965561, 0.61), Vector(13.77483365, -1.954109924, 0.61), Vector(14.05456228, -1.995965561, 0.61), Vector(13.77483365, -1.954109924, 0.61)]))
window_frame = Brep(flatten([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]))
window_glass = Brep(flatten([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]))
surrounding = Brep(flatten([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]))
windowcrv = Curve(flatten([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]))
floor = Brep(flatten(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))
ceiling = Brep(flatten(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))
balcony = Brep(flatten(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))
wall = Brep(flatten(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))

csr_results_path = Data(concatenate_2)
epw_path = Data(concatenate)

# ----
# Window Niche to Openings
window_niches = Brep(window_nische)
cap_holes = CapHoles(Brep=window_niches)  # -> simplify(Brep)
deconstruct_brep = DeconstructBrep(Brep=window_niches)  # -> simplify(Faces), Edges, Vertices
deconstruct_brep_2 = DeconstructBrep(Brep=cap_holes)  # -> simplify(Faces), Edges, Vertices
area = Area(Geometry=deconstruct_brep_2.Faces)  # -> Area, Centroid
area_2 = Area(Geometry=deconstruct_brep.Faces)  # -> Area, Centroid
merge = Merge(Data1=area.Centroid, Data2=area_2.Centroid)
cull_duplicates = CullDuplicates(Points=merge, Tolerance=0.1, CullMode=3)  # -> Points, simplify(Indices), Valence
equality = Equality(FirstNumber=cull_duplicates.Indices, SecondNumber=-1)  # -> Equality, Inequality
cull_pattern = CullPattern(List=cull_duplicates.Indices, CullPattern=equality.Inequality)
list_item = ListItem(List=deconstruct_brep_2.Faces, Index=cull_pattern, Wrap=True)  # -> simplify(Item)
window_opening_surface = Geometry(list_item)
list_item_2 = ListItem(List=window_opening_surface, Index=0, Wrap=True)

# ----
# Input
window_opening_surface_2 = Geometry(list_item_2)
window_nische_2 = Brep(window_nische)
# Encoding common geometry input
window_vector_2 = Vector(window_vector)
window_glass_2 = Brep(window_glass)
context = Brep(surrounding)
balcony_2 = Brep(balcony)
floor_2 = Brep(floor)
facade = Brep(wall)
roof = Brep(ceiling)
merge_2 = Merge(Data1=facade, Data2=roof, Data3=context, Data4=window_opening_surface_2, Data5=balcony_2)
context_2 = MeshJoin(Meshes=flatten(merge_2))

load_cs_result = LoadCSResult(
    Result=csr_results_path,
    Header=False,
    Output_0_Hidden=False,
    Output_0_Name="Name",
    Output_10_Hidden=False,
    Output_10_Name="Window Groups",
    Output_11_Hidden=True,
    Output_11_Name="Weather",
    Output_12_Hidden=True,
    Output_12_Name="North",
    Output_13_Hidden=True,
    Output_13_Name="LayerNames",
    Output_14_Hidden=True,
    Output_14_Name="LayerObjects",
    Output_15_Hidden=True,
    Output_15_Name="LayerMaterials",
    Output_16_Hidden=True,
    Output_16_Name="Sky",
    Output_1_Hidden=False,
    Output_1_Name="Type",
    Output_2_Hidden=True,
    Output_2_Name="Standard",
    Output_3_Hidden=True,
    Output_3_Name="Date",
    Output_4_Hidden=True,
    Output_4_Name="Version",
    Output_5_Hidden=True,
    Output_5_Name="FileSize",
    Output_6_Hidden=True,
    Output_6_Name="RunLog",
    Output_7_Hidden=False,
    Output_7_Name="Metrics",
    Output_8_Hidden=False,
    Output_8_Name="MetricValues",
    Output_9_Hidden=False,
    Output_9_Name="Grids",
    UnitSystem=4)  # -> Name, Type, Metrics, MetricValues, Grids, WindowGroups
preview_cs_sensorgrid = PreviewCSSensorGrid(
    Grid=load_cs_result.Grids,
    Metric="Daylight Automony (300 lux) (Sensor Array) [fraction of daylight hours]",
    Input_0_Hidden=False,
    Input_0_Name="Grid",
    Input_1_Hidden=False,
    Input_1_Name="Metric",
    Input_2_Hidden=True,
    Input_2_Name="Falsecolor",
    Input_3_Hidden=True,
    Input_3_Name="Sensor Values",
    Input_4_Hidden=True,
    Input_4_Name="Show Points",
    Input_5_Hidden=True,
    Input_5_Name="Show Edges",
    Input_6_Hidden=True,
    Input_6_Name="Show Labels",
    Input_7_Hidden=True,
    Input_7_Name="Label Format",
    Input_8_Hidden=True,
    Input_8_Name="Transform",
    Output_0_Hidden=True,
    Output_0_Name="Mesh",
    Output_1_Hidden=True,
    Output_1_Name="Texture",
    UnitSystem=4,
    Input_4_GHParam_Branch0_Path="{0}",
    Input_4_GHParam_Branch0_Item0_boolean=True,
    Input_5_GHParam_Branch0_Path="{0}",
    Input_5_GHParam_Branch0_Item0_boolean=True,
    Input_6_GHParam_Branch0_Path="{0}",
    Input_6_GHParam_Branch0_Item0_boolean=False)
panel_2 = Panel(load_cs_result.Name)
panel_3 = Panel(load_cs_result.Metrics)
panel_4 = Panel(load_cs_result.MetricValues)

panel_5 = Panel(epw_path)
epw_file = Text(panel_5)

# ----
# Encoding common encoding features
# SkyDome Generation
# Simulation result common encdoding
epw_file_path = Text(epw_file)
importepw = LBImportEPW(epw_file=epw_file_path)  # -> location, dry_bulb_temperature, dew_point_temperature, relative_humidity, wind_speed, wind_direction, direct_normal_rad, diffuse_horizontal_rad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; plug-in component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
colrange = LBColorRange(index="3")  # -> colors; plug-in component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
shift_list = ShiftList(List=colrange, Shift=1, Wrap=Toggle(False))
skymatrix = LBCumulativeSkyMatrix(
    location=importepw.location,
    direct_rad=importepw.direct_normal_rad,
    diffuse_rad=importepw.diffuse_horizontal_rad,
    high_density=Toggle(True))  # -> out, sky_mtx; plug-in component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
legendpar = LBLegendParameters(min="0", max="100", seg_count="11", colors=shift_list, num_decimals="1")  # -> leg_par; plug-in component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
skydome = LBSkyDome(sky_mtx=skymatrix.sky_mtx, projection="Orthographic")  # -> out, mesh, compass, legend, title, patch_vecs, patch_values, mesh_values, vis_set; plug-in component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

# ----
# Read the results
# Results multiplication
# Metric: Daylight Autonomy (300 lux) (Sensor Array)
csgrids = Data(load_cs_result.Grids)
deconstruct_cs_sensorgrid = DeconstructCSSensorGrid(
    Grid=csgrids,
    Output_0_Hidden=False,
    Output_0_Name="Building",
    Output_10_Hidden=True,
    Output_10_Name="Analysis Surface",
    Output_11_Hidden=True,
    Output_11_Name="Edges",
    Output_12_Hidden=True,
    Output_12_Name="View Points",
    Output_13_Hidden=True,
    Output_13_Name="Area",
    Output_14_Hidden=True,
    Output_14_Name="View Directions",
    Output_15_Hidden=False,
    Output_15_Name="Occupancy",
    Output_16_Hidden=True,
    Output_16_Name="View Wedges",
    Output_17_Hidden=True,
    Output_17_Name="Supplemental Lux",
    Output_18_Hidden=True,
    Output_18_Name="Target Lux",
    Output_19_Hidden=True,
    Output_19_Name="Excessive Lux",
    Output_1_Hidden=False,
    Output_1_Name="Level",
    Output_20_Hidden=True,
    Output_20_Name="Normal Override",
    Output_21_Hidden=True,
    Output_21_Name="Use Normal Override",
    Output_22_Hidden=True,
    Output_22_Name="Perimeter Edges"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)  # -> Building, Level, ID, SensorPoints, WindowGroups, Occupancy
extract_cs_sensorgrid_data = ExtractCSSensorGridData(
    Grid=csgrids,
    Metric="Daylight Automony (300 lux) (Sensor Array) [fraction of daylight hours]",
    Input_0_Hidden=False,
    Input_0_Name="Grid",
    Input_1_Hidden=False,
    Input_1_Name="Metric",
    UnitSystem=4)  # -> Metric, ValueS
multiplication = Multiplication(A=extract_cs_sensorgrid_data.ValueS, B="100")
floor_surface = Surface(floor_2)
data = Data(extract_cs_sensorgrid_data.Metric)
data_2 = Data(extract_cs_sensorgrid_data.ValueS)
panel_6 = Panel(data)
panel_7 = Panel(data_2)
genpts = LBGeneratePointGrid(geometry=floor_surface, grid_size="0.2")  # -> points, vectors, face_areas, mesh; plug-in component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
unit_z = UnitZ(Factor="0.8")
move = Move(Geometry=genpts.mesh, Motion=unit_z)  # -> Geometry, Transform
face_boundaries = FaceBoundaries(Mesh=move.Geometry)
area_3 = Area(Geometry=face_boundaries)  # -> Area, Centroid
closest_point = ClosestPoint(Point=area_3.Centroid, Cloud=flatten(deconstruct_cs_sensorgrid.SensorPoints))  # -> ClosestPoint, CPIndex, Distance
mesh_join = MeshJoin(Meshes=flatten(move.Geometry))
list_item_3 = ListItem(List=flatten(multiplication), Index=closest_point.CPIndex, Wrap=True)
heatmap = LBSpatialHeatmap(values=flatten(list_item_3), mesh=mesh_join, legend_par=legendpar)  # -> mesh, legend, title, colors, legend_par; plug-in component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

path_for_encoded_red_blue_room_image = Panel("\encoding1\red-blue\")
path_for_encoded_room_image_green_alpha = Panel("\encoding1\green-alpha\")
path_for_ground_truth_image = Panel("\encoding1\groundtruth\")

path_for_encoded_red_blue_room_image_2 = Panel("\encoding2\red\")
path_for_encoded_room_image_green_alpha_2 = Panel("\encoding2\green\")
path_for_encoded_red_blue_room_image_3 = Panel("\encoding2\blue\")
path_for_encoded_room_image_green_alpha_3 = Panel("\encoding2\alpha\")
path_for_ground_truth_image_2 = Panel("\encoding2\groundtruth\")

floor_surface_2 = Surface(floor_2)
bounding_rectangle = BoundingRectangle(Geometry=floor_surface_2, Plane=PlaneXY(0, 0, 0), Axis=0, Slide=0, Union=True)  # -> Bounding, DimensionX, DimensionY
area_4 = Area(Geometry=bounding_rectangle.Bounding)  # -> Area, Centroid

concatenate_3 = Concatenate(FragmentA=panel, FragmentB=path_for_ground_truth_image)
concatenate_4 = Concatenate(FragmentA=panel, FragmentB=path_for_encoded_red_blue_room_image)
concatenate_5 = Concatenate(FragmentA=panel, FragmentB=path_for_encoded_room_image_green_alpha)

encoded_picture_frame = Brep(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)
scale_factor_for_image = Panel("25")

concatenate_6 = Concatenate(FragmentA=panel, FragmentB=path_for_ground_truth_image_2)
concatenate_7 = Concatenate(FragmentA=panel, FragmentB=path_for_encoded_red_blue_room_image_2)
concatenate_8 = Concatenate(FragmentA=panel, FragmentB=path_for_encoded_red_blue_room_image_3)
concatenate_9 = Concatenate(FragmentA=panel, FragmentB=path_for_encoded_room_image_green_alpha_2)
concatenate_10 = Concatenate(FragmentA=panel, FragmentB=path_for_encoded_room_image_green_alpha_3)

# ----
# Fixed Picture Frame
encoded_picture_frame_2 = Brep(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)
scale_factor_for_image_2 = Panel("25")

# ----
# Plane Perpendicular to Window for Orientation
floor_surface_3 = Surface(floor_2)
bounding_rectangle_2 = BoundingRectangle(Geometry=floor_surface_3, Plane=PlaneXY(0, 0, 0), Axis=0, Slide=0, Union=True)  # -> Bounding, DimensionX, DimensionY
area_5 = Area(Geometry=bounding_rectangle_2.Bounding)  # -> Area, Centroid

text_split = TextSplit(Text=panel_2, Separators="_")
list_item_4 = ListItem(List=text_split, Index=0, Wrap=True)

# ----
# text generation for naming
panel_8 = Panel("_")
text_split_2 = TextSplit(Text=panel_2, Separators=panel_8)
list_item_5 = ListItem(List=text_split_2, Index=0, Wrap=True)

sky_dome_mesh = Mesh(skydome.mesh)
deconstruct_mesh = DeconstructMesh(Mesh=sky_dome_mesh)  # -> Vertices, Faces, Colours, Normals
remap_numbers = RemapNumbers(Value=skydome.mesh_values, Source="0 to 50", Target="0 to 255")  # -> Mapped, Clipped
construct_mesh = ConstructMesh(Vertices=deconstruct_mesh.Vertices, Faces=deconstruct_mesh.Faces)
colour_rgb = ColourRGB(Alpha=255, Red=remap_numbers.Mapped, Green=0, Blue=0)  # -> simplify(flatten(Colour))
scale = Scale(Geometry=construct_mesh, Center=Point(0, 0, 0), Factor="0.1024")  # -> Geometry, Transform
face_boundaries_2 = FaceBoundaries(Mesh=scale.Geometry)  # -> simplify(flatten(Boundaries))
create_gdi_fill = CreateGdiFill(Colour=colour_rgb)
create_gdi_shape = CreateGdiShape(Geometry=face_boundaries_2, Fill=create_gdi_fill)  # -> flatten(Shape)

surface = Surface(face_boundaries_2)
custom_preview = CustomPreview(Geometry=surface, Material=colour_rgb)

# ----
# Encoding method 1
xy_plane = XYPlane(Origin=Point(0, 0, 0))
window_point_plane = Plane(area_4.Centroid)
window_point_plane_2 = Plane(area_4.Centroid)
window_point_plane_3 = Plane(area_4.Centroid)
window_point_plane_4 = Plane(area_4.Centroid)
obstructions_mesh = Mesh(context_2)
window_niche = Brep(window_nische_2)
window_glass_3 = Surface(window_glass_2)
floor_surface_4 = Surface(floor_2)
target_plane = Plane(xy_plane)
point_0_0_0_8 = Point(Point(0, 0, 0.8))
window_niche_2 = Brep(graft(window_nische_2))
floor_surface_5 = Surface(floor_2)
curve = Curve([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])
taget_plane = Plane(xy_plane)
picture_frame_curve = Curve(encoded_picture_frame)
scale_factor_for_image_3 = Number(scale_factor_for_image)
path_for_red_blue = Text(concatenate_4)
path_for_groundtruth = Text(concatenate_3)
naming = Text(list_item_4)
naming_2 = Text(list_item_4)
picture_frame_curve_2 = Curve(encoded_picture_frame)
colour_rgb_2 = ColourRGB(Alpha=255, Red=0, Green=0, Blue="255")
path_for_green_alpha = Text(concatenate_5)
naming_3 = Text(list_item_4)
scale_factor_for_image_4 = Number(scale_factor_for_image)

# ----
# Oriented Obstructions
target_plane_2 = Plane(xy_plane)
orient = Orient(Geometry=obstructions_mesh, Source=window_point_plane_3, Target=target_plane_2)  # -> Geometry, Transform

target_plane_3 = Plane(xy_plane)

# ----
# Oriented Window Niche
target_plane_4 = Plane(xy_plane)
orient_2 = Orient(Geometry=window_niche, Source=window_point_plane, Target=target_plane_4)  # -> Geometry, Transform

# ---- group: Orient
# Oriented Window Glass
orient_3 = Orient(Geometry=window_glass_3, Source=window_point_plane_2, Target=target_plane_3)  # -> Geometry, Transform

# ----
# Oriented Room Floor
orient_4 = Orient(Geometry=floor_surface_4, Source=window_point_plane_4, Target=target_plane)  # -> Geometry, Transform

window_point_plane_5 = Plane(area_4.Centroid)
orient_5 = Orient(Geometry=heatmap.mesh, Source=window_point_plane_5, Target=taget_plane)  # -> Geometry, Transform

box = Box(window_niche_2)
deconstruct_box = DeconstructBox(Box=box)  # -> Plane, X, Y, simplify(Z)
deconstruct_domain = DeconstructDomain(Domain=deconstruct_box.Z)  # -> Start, End
subtraction = Subtraction(A=deconstruct_domain.End, B=deconstruct_domain.Start)
construct_domain = ConstructDomain(DomainStart="0.5", DomainEnd="5")
remap_numbers_2 = RemapNumbers(Value=subtraction, Source=construct_domain, Target="55 to 255")  # -> Mapped, Clipped

area_6 = Area(Geometry=floor_surface_5)  # -> Area, Centroid
deconstruct = Deconstruct(Point=area_6.Centroid)  # -> XComponent, YComponent, ZComponent
subtraction_2 = Subtraction(A=deconstruct_domain.Start, B=deconstruct.ZComponent)
construct_domain_2 = ConstructDomain(DomainStart="0", DomainEnd="5")
remap_numbers_3 = RemapNumbers(Value=subtraction_2, Source=construct_domain_2, Target="55 to 255")  # -> Mapped, Clipped

colour_rgb_3 = ColourRGB(Alpha=255, Red=0, Green=0, Blue="0")
oriented_floor_surface = Surface(orient_4.Geometry)
project = Project(Geometry=oriented_floor_surface, Plane=PlaneXY(0, 0, 0))  # -> Geometry, Transform
create_gdi_fill_2 = CreateGdiFill(Colour=colour_rgb_3)
roomascrv = Curve(project.Geometry)
create_gdi_shape_2 = CreateGdiShape(Geometry=roomascrv, Fill=create_gdi_fill_2)

previewroom = CustomPreview(Geometry=oriented_floor_surface, Material=ColourSwatch(SwatchColor=RGB(255, 255, 255)))

oriented_window_niche = Brep(orient_2.Geometry)
oriented_obstructions_mesh = Mesh(orient.Geometry)
oriented_window_niche_2 = Brep(orient_2.Geometry)
oriented_results_mesh = Mesh(orient_5.Geometry)
colour_rgb_4 = ColourRGB(Alpha=255, Red=0, Green=remap_numbers_2.Mapped, Blue=remap_numbers_3.Mapped)

# ----
# Window Niche to Openings
cap_holes_2 = CapHoles(Brep=oriented_window_niche)  # -> simplify(Brep)
deconstruct_brep_3 = DeconstructBrep(Brep=oriented_window_niche)  # -> simplify(Faces), Edges, Vertices
deconstruct_brep_4 = DeconstructBrep(Brep=cap_holes_2)  # -> simplify(Faces), Edges, Vertices
area_7 = Area(Geometry=deconstruct_brep_4.Faces)  # -> Area, Centroid
area_8 = Area(Geometry=deconstruct_brep_3.Faces)  # -> Area, Centroid
merge_3 = Merge(Data1=area_7.Centroid, Data2=area_8.Centroid)
cull_duplicates_2 = CullDuplicates(Points=merge_3, Tolerance=0.1, CullMode=3)  # -> Points, simplify(Indices), Valence
equality_2 = Equality(FirstNumber=cull_duplicates_2.Indices, SecondNumber=-1)  # -> Equality, Inequality
cull_pattern_2 = CullPattern(List=cull_duplicates_2.Indices, CullPattern=equality_2.Inequality)
list_item_6 = ListItem(List=deconstruct_brep_4.Faces, Index=cull_pattern_2, Wrap=True)  # -> simplify(Item)

deconstruct_brep_5 = DeconstructBrep(Brep=oriented_window_niche_2)  # -> simplify(Faces), Edges, Vertices
md_slider = MDSlider(SliderMode=0, slider_value=Point(0.5, 0.5, 0.5), x_domain=Domain(0, 1), y_domain=Domain(0, 1), z_domain=Domain(0, 1))
evaluate_surface = EvaluateSurface(Surface=deconstruct_brep_5.Faces, Point=md_slider)  # -> Point, Normal, UDirection, VDirection, Frame
deconstruct_vector = DeconstructVector(Vector=evaluate_surface.Normal)  # -> XComponent, YComponent, ZComponent
equality_3 = Equality(FirstNumber=deconstruct_vector.ZComponent, SecondNumber=1)  # -> Equality, Inequality
cull_pattern_3 = CullPattern(List=deconstruct_brep_5.Faces, CullPattern=equality_3.Equality)

df_results = Mesh(oriented_results_mesh)
face_boundaries_3 = FaceBoundaries(Mesh=df_results)
deconstruct_mesh_2 = DeconstructMesh(Mesh=df_results)  # -> Vertices, Faces, Colours, Normals
deconstruct_face = DeconstructFace(Face=deconstruct_mesh_2.Faces)  # -> CornerA, CornerB, CornerC, CornerD
list_item_7 = ListItem(List=deconstruct_mesh_2.Colours, Index=deconstruct_face.CornerA, Wrap=True)
create_gdi_fill_3 = CreateGdiFill(Colour=list_item_7)
create_gdi_shape_3 = CreateGdiShape(Geometry=face_boundaries_3, Fill=create_gdi_fill_3)  # -> flatten(Shape)

concatenate_11 = Concatenate(FragmentA=path_for_groundtruth, FragmentC=naming_2, FragmentD=".png")
draw_image = DrawImage(
    Shapes=simplify(create_gdi_shape_3),
    Size=picture_frame_curve_2,
    Factor=scale_factor_for_image_3,
    Background=RGB(0, 0, 0),
    AntiAlias=False,
    FileLocation=simplify(concatenate_11))

# ----
# Encoding method 2
# This generates the ground truth from a file of simulation results, we can remove this in the end
window_point_plane_6 = Plane(area_5.Centroid)
window_point_plane_7 = Plane(area_5.Centroid)
window_point_plane_8 = Plane(area_5.Centroid)
obstructions_mesh_2 = Mesh(context_2)
window_point_plane_9 = Plane(area_5.Centroid)
window_niche_3 = Brep(window_nische_2)
floor_surface_6 = Surface(floor_2)
window_glass_4 = Surface(window_glass_2)
xy_plane_2 = XYPlane(Origin=Point(0, 0, 0))
taget_plane_2 = Plane(xy_plane_2)
taget_plane_3 = Plane(xy_plane_2)
taget_plane_4 = Plane(xy_plane_2)
scale_factor = Panel("0.08")
window_niche_4 = Brep(graft(window_nische_2))
floor_surface_7 = Surface(floor_2)
taget_plane_5 = Plane(xy_plane_2)
unit_z_2 = UnitZ(Factor="-900")
unit_z_3 = UnitZ(Factor=-900)
scale_factor_for_image_5 = Number(scale_factor_for_image_2)
path_for_groundtruth_2 = Text(concatenate_6)
picture_frame_curve_3 = Curve(encoded_picture_frame_2)
picture_frame_curve_4 = Curve(encoded_picture_frame_2)
path_for_blue = Text(concatenate_8)
path_for_red = Text(concatenate_7)
naming_4 = Text(list_item_5)
naming_5 = Text(list_item_5)
naming_6 = Text(list_item_5)
picture_frame_curve_5 = Curve(encoded_picture_frame_2)
colour_rgb_5 = ColourRGB(Alpha=255, Red=0, Green=0, Blue="255")
picture_frame_curve_6 = Curve(encoded_picture_frame_2)
path_for_green = Text(concatenate_9)
naming_7 = Text(list_item_5)
path_for_alpha = Text(concatenate_10)
naming_8 = Text(list_item_5)
scale_factor_for_image_6 = Number(scale_factor_for_image_2)

taget_plane_6 = Plane(xy_plane_2)
orient_6 = Orient(Geometry=window_niche_3, Source=window_point_plane_7, Target=taget_plane_6)  # -> Geometry, Transform

orient_7 = Orient(Geometry=obstructions_mesh_2, Source=window_point_plane_8, Target=taget_plane_3)  # -> Geometry, Transform

orient_8 = Orient(Geometry=floor_surface_6, Source=window_point_plane_6, Target=taget_plane_2)  # -> Geometry, Transform

orient_9 = Orient(Geometry=window_glass_4, Source=window_point_plane_9, Target=taget_plane_4)  # -> Geometry, Transform

# ----
# Orienting Results Mesh
window_point_plane_10 = Plane(area_5.Centroid)
orient_10 = Orient(Geometry=heatmap.mesh, Source=window_point_plane_10, Target=taget_plane_5)  # -> Geometry, Transform

box_2 = Box(window_niche_4)
deconstruct_box_2 = DeconstructBox(Box=box_2)  # -> Plane, X, Y, simplify(Z)
deconstruct_domain_2 = DeconstructDomain(Domain=deconstruct_box_2.Z)  # -> Start, End
subtraction_3 = Subtraction(A=deconstruct_domain_2.End, B=deconstruct_domain_2.Start)
construct_domain_3 = ConstructDomain(DomainStart="0.5", DomainEnd="5")
remap_numbers_4 = RemapNumbers(Value=subtraction_3, Source=construct_domain_3, Target="55 to 255")  # -> Mapped, Clipped

colour_rgb_6 = ColourRGB(Alpha=255, Red=0, Green=0, Blue="0")
oriented_floor_surface_2 = Surface(orient_8.Geometry)
project_2 = Project(Geometry=oriented_floor_surface_2, Plane=PlaneXY(0, 0, 0))  # -> Geometry, Transform
create_gdi_fill_4 = CreateGdiFill(Colour=colour_rgb_6)
roomascrv_2 = Curve(project_2.Geometry)
create_gdi_shape_4 = CreateGdiShape(Geometry=roomascrv_2, Fill=create_gdi_fill_4)

previewroom_2 = CustomPreview(Geometry=oriented_floor_surface_2, Material=ColourSwatch(SwatchColor=RGB(255, 255, 255)))

project_3 = Project(Geometry=picture_frame_curve_3, Plane=PlaneXY(0, 0, 0))  # -> Geometry, Transform
concatenate_12 = Concatenate(FragmentA=path_for_red, FragmentC=naming_5, FragmentD=".png")
scale_factor_for_image_7 = Number(scale_factor_for_image_2)
draw_image_2 = DrawImage(
    Shapes=simplify(create_gdi_shape),
    Size=project_3.Geometry,
    Factor=scale_factor_for_image_7,
    Background=RGB(0, 0, 0),
    AntiAlias=False,
    FileLocation=simplify(concatenate_12))

oriented_window_niche_3 = Brep(orient_6.Geometry)
oriented_window_niche_4 = Brep(orient_6.Geometry)
orianted_obstructions_mesh = Mesh(orient_7.Geometry)
oriented_results_mesh_2 = Mesh(orient_10.Geometry)
colour_rgb_7 = ColourRGB(Alpha=255, Red=0, Green=0, Blue=remap_numbers_4.Mapped)

cap_holes_3 = CapHoles(Brep=oriented_window_niche_3)  # -> simplify(Brep)
deconstruct_brep_6 = DeconstructBrep(Brep=oriented_window_niche_3)  # -> simplify(Faces), Edges, Vertices
deconstruct_brep_7 = DeconstructBrep(Brep=cap_holes_3)  # -> simplify(Faces), Edges, Vertices
area_9 = Area(Geometry=deconstruct_brep_7.Faces)  # -> Area, Centroid
area_10 = Area(Geometry=deconstruct_brep_6.Faces)  # -> Area, Centroid
merge_4 = Merge(Data1=area_9.Centroid, Data2=area_10.Centroid)
cull_duplicates_3 = CullDuplicates(Points=merge_4, Tolerance=0.1, CullMode=3)  # -> Points, simplify(Indices), Valence
equality_4 = Equality(FirstNumber=cull_duplicates_3.Indices, SecondNumber=-1)  # -> Equality, Inequality
cull_pattern_4 = CullPattern(List=cull_duplicates_3.Indices, CullPattern=equality_4.Inequality)
list_item_8 = ListItem(List=deconstruct_brep_7.Faces, Index=cull_pattern_4, Wrap=True)  # -> simplify(Item)

deconstruct_brep_8 = DeconstructBrep(Brep=oriented_window_niche_4)  # -> simplify(Faces), Edges, Vertices
md_slider_2 = MDSlider(SliderMode=0, slider_value=Point(0.5, 0.5, 0.5), x_domain=Domain(0, 1), y_domain=Domain(0, 1), z_domain=Domain(0, 1))
evaluate_surface_2 = EvaluateSurface(Surface=deconstruct_brep_8.Faces, Point=md_slider_2)  # -> Point, Normal, UDirection, VDirection, Frame
deconstruct_vector_2 = DeconstructVector(Vector=evaluate_surface_2.Normal)  # -> XComponent, YComponent, ZComponent
equality_5 = Equality(FirstNumber=deconstruct_vector_2.ZComponent, SecondNumber=1)  # -> Equality, Inequality
cull_pattern_5 = CullPattern(List=deconstruct_brep_8.Faces, CullPattern=equality_5.Equality)

df_results_2 = Mesh(oriented_results_mesh_2)
face_boundaries_4 = FaceBoundaries(Mesh=df_results_2)
deconstruct_mesh_3 = DeconstructMesh(Mesh=df_results_2)  # -> Vertices, Faces, Colours, Normals
deconstruct_face_2 = DeconstructFace(Face=deconstruct_mesh_3.Faces)  # -> CornerA, CornerB, CornerC, CornerD
list_item_9 = ListItem(List=deconstruct_mesh_3.Colours, Index=deconstruct_face_2.CornerA, Wrap=True)
create_gdi_fill_5 = CreateGdiFill(Colour=list_item_9)
create_gdi_shape_5 = CreateGdiShape(Geometry=face_boundaries_4, Fill=create_gdi_fill_5)  # -> flatten(Shape)

concatenate_13 = Concatenate(FragmentA=path_for_groundtruth_2, FragmentC=naming_4, FragmentD=".png")
draw_image_3 = DrawImage(
    Shapes=simplify(create_gdi_shape_5),
    Size=picture_frame_curve_5,
    Factor=scale_factor_for_image_5,
    Background=RGB(0, 0, 0),
    AntiAlias=False,
    FileLocation=simplify(concatenate_13))

window_opening_surface_3 = Geometry(list_item_8)
window_sill = Brep(cull_pattern_5)

oriented_window_glass = Surface(orient_9.Geometry)
list_item_10 = ListItem(List=window_opening_surface_3, Index=0, Wrap=True)
area_11 = Area(Geometry=simplify(graft(oriented_window_glass)))  # -> Area, Centroid
area_12 = Area(Geometry=list_item_10)  # -> Area, Centroid
division = Division(A=area_11.Area, B=area_12.Area)
expression = Expression(x=division, Expression="Round(x,2)")

window_opening_surface_4 = Geometry(list_item_6)
window_sill_2 = Brep(cull_pattern_3)
curve_2 = Curve(window_sill_2)
explode = Explode(Curve=curve_2, Recursive=True)  # -> Segments, Vertices
list_item_11 = ListItem(List=explode.Vertices, Index=0, Wrap=True)  # -> Item, Item1, Item2, Item3, Item4, Item5
vector_2pt = Vector2Pt(PointA=list_item_11.Item5, PointB=list_item_11.Item2, Unitize=invert(False))  # -> Vector, Length

oriented_window_glass_2 = Surface(orient_3.Geometry)
list_item_12 = ListItem(List=window_opening_surface_4, Index=0, Wrap=True)
area_13 = Area(Geometry=simplify(graft(oriented_window_glass_2)))  # -> Area, Centroid
area_14 = Area(Geometry=list_item_12)  # -> Area, Centroid
division_2 = Division(A=area_13.Area, B=area_14.Area)
expression_2 = Expression(x=division_2, Expression="Round(x,2)")

curve_3 = Curve(window_sill)
discontinuity = Discontinuity(Curve=curve_3, Level=1)  # -> Points, Parameters
polyline = PolyLine(Vertices=discontinuity.Points, Closed=invert(False))
explode_2 = Explode(Curve=polyline, Recursive=True)  # -> Segments, Vertices
curve_middle = CurveMiddle(Curve=explode_2.Segments)  # -> simplify(Midpoint)
project_4 = Project(Geometry=curve_middle, Plane=PlaneXY(0, 0, 0))  # -> Geometry, Transform
oriented_floor_surface_3 = Surface(orient_8.Geometry)
pull_point = PullPoint(Point=project_4.Geometry, Geometry=oriented_floor_surface_3, ClosestOnly=True)  # -> ClosestPoint, Distance
sort_list = SortList(Keys=pull_point.Distance, ValuesValuesA=explode_2.Segments, ValuesA=curve_middle)  # -> Keys, simplify(ValuesValuesA), simplify(ValuesA)
list_item_13 = ListItem(List=sort_list.ValuesValuesA, Index=0, Wrap=True)
list_item_14 = ListItem(List=sort_list.ValuesValuesA, Index="-1", Wrap=True)
list_item_15 = ListItem(List=sort_list.ValuesA, Index="-1", Wrap=True)
end_points = EndPoints(Curve=list_item_13)  # -> Start, End

frame_factor_0_1_1_being_100_glazed_with = Panel(expression)  # "Frame factor (0-1) 1 being 100% glazed (without frame)"
explode_3 = Explode(Curve=curve_3, Recursive=True)  # -> Segments, Vertices
list_item_16 = ListItem(List=explode_3.Vertices, Index=0, Wrap=True)  # -> Item, Item1, Item2, Item3, Item4, Item5
vector_2pt_2 = Vector2Pt(PointA=list_item_16.Item5, PointB=list_item_16.Item2, Unitize=invert(False))  # -> Vector, Length

area_15 = Area(Geometry=floor_surface_7)  # -> Area, Centroid
deconstruct_2 = Deconstruct(Point=area_15.Centroid)  # -> XComponent, YComponent, ZComponent
subtraction_4 = Subtraction(A=deconstruct_domain_2.Start, B=deconstruct_2.ZComponent)
multiplication_2 = Multiplication(A=subtraction_4, B=0.2)
amplitude = Amplitude(Vector=vector_2pt_2.Vector, Amplitude=multiplication_2)  # -> simplify(Vector)

scale_2 = Scale(Geometry=list_item_14, Center=list_item_15, Factor=frame_factor_0_1_1_being_100_glazed_with)  # -> Geometry, Transform
end_points_2 = EndPoints(Curve=scale_2.Geometry)  # -> Start, End
line = Line(StartPoint=end_points.Start, EndPoint=end_points_2.End)
line_2 = Line(StartPoint=end_points_2.Start, EndPoint=end_points.End)
join_curves = JoinCurves(Curves=[list_item_13, line, scale_2.Geometry, line_2], Preserve=False)  # -> simplify(Curves)
boundary_surfaces = BoundarySurfaces(Edges=join_curves)

window_opening_surface_mesh = Mesh(list_item_12)
mesh_join_2 = MeshJoin(Meshes=flatten([window_opening_surface_mesh, oriented_obstructions_mesh]))
oriented_context_mesh = Mesh(mesh_join_2)
frame_factor_0_1_zero_being_100_glazed_w = Panel(expression_2)  # "Frame factor (0-1) zero being 100% glazed (without frame)"
multiplication_3 = Multiplication(A=frame_factor_0_1_zero_being_100_glazed_w, B=0.2)
amplitude_2 = Amplitude(Vector=vector_2pt.Vector, Amplitude=multiplication_3)  # -> simplify(Vector)
move_2 = Move(Geometry=window_sill_2, Motion=amplitude_2)  # -> Geometry, Transform

mesh_curve = MeshCurve(Mesh=oriented_context_mesh, Curve=curve)  # -> simplify(Points), Faces
list_item_17 = ListItem(List=mesh_curve.Points, Index="1", Wrap=False)  # -> flatten(Item)
distance = Distance(PointA=point_0_0_0_8, PointB=list_item_17)
remap_numbers_5 = RemapNumbers(Value=distance, Source="0 to 255", Target="255 to 0")  # -> Mapped, Clipped

windowsillcrv = Curve(move_2.Geometry)
color_window = Colour(colour_rgb_4)
create_gdi_fill_6 = CreateGdiFill(Colour=color_window)
create_gdi_shape_6 = CreateGdiShape(Geometry=windowsillcrv, Fill=create_gdi_fill_6)  # -> flatten(EncodedWindow)

ghpython_script = GhPythonScript(x=remap_numbers_5.Mapped)  # -> a
# ---------- ghpython_script: Python ----------
import ghpythonlib.components as ghcomp

# Function to replace None with 0
def replace_none(value):
    if value is None:
        return 0
    else:
        return value

# Check if the input is a list
if isinstance(x, list):
    # If input is a list, process each item
    result = [replace_none(item) for item in x]
else:
    # If input is a single value, process it directly
    result = replace_none(x)

a = result
# ---------- end ghpython_script ----------
merge_5 = Merge(Data1=flatten(create_gdi_shape_2), Data2=flatten(create_gdi_shape_6))

mesh = Mesh(skydome.mesh)
deconstruct_mesh_4 = DeconstructMesh(Mesh=mesh)  # -> Vertices, Faces, Colours, Normals
remap_numbers_6 = RemapNumbers(Value=skydome.mesh_values, Source="0 to 50", Target="0 to 255")  # -> Mapped, Clipped
construct_mesh_2 = ConstructMesh(Vertices=deconstruct_mesh_4.Vertices, Faces=deconstruct_mesh_4.Faces)
colour_rgb_8 = ColourRGB(Alpha=255, Red=remap_numbers_6.Mapped, Green=0, Blue=ghpython_script)  # -> simplify(flatten(Colour))
scale_3 = Scale(Geometry=construct_mesh_2, Center=Point(0, 0, 0), Factor="0.1024")  # -> Geometry, Transform
face_boundaries_5 = FaceBoundaries(Mesh=scale_3.Geometry)  # -> simplify(flatten(Boundaries))
create_gdi_fill_7 = CreateGdiFill(Colour=colour_rgb_8)
create_gdi_shape_7 = CreateGdiShape(Geometry=face_boundaries_5, Fill=create_gdi_fill_7)  # -> flatten(Shape)

windowsillmesh = Mesh(move_2.Geometry)
previewwindow = CustomPreview(Geometry=windowsillmesh, Material=colour_rgb_4)

surface_2 = Surface(face_boundaries_5)
custom_preview_2 = CustomPreview(Geometry=surface_2, Material=colour_rgb_8)

project_5 = Project(Geometry=picture_frame_curve, Plane=PlaneXY(0, 0, 0))  # -> Geometry, Transform
concatenate_14 = Concatenate(FragmentA=path_for_red_blue, FragmentC=naming, FragmentD=".png")
scale_factor_for_image_8 = Number(scale_factor_for_image)
draw_image_4 = DrawImage(
    Shapes=simplify(create_gdi_shape_7),
    Size=project_5.Geometry,
    Factor=scale_factor_for_image_8,
    Background=RGB(0, 0, 0),
    AntiAlias=False,
    FileLocation=simplify(concatenate_14))

picture_frame_curve_7 = Curve(encoded_picture_frame)
project_6 = Project(Geometry=picture_frame_curve_7, Plane=PlaneXY(0, 0, 0))  # -> Geometry, Transform
concatenate_15 = Concatenate(FragmentA=path_for_green_alpha, FragmentC=naming_3, FragmentD=".png")
draw_image_5 = DrawImage(
    Shapes=simplify(merge_5),
    Size=project_6.Geometry,
    Factor=scale_factor_for_image_4,
    Background=colour_rgb_2,
    AntiAlias=False,
    FileLocation=simplify(concatenate_15))

point = Point(Point(-128, -128, 0.8))
rectangular = Rectangular(Plane=point, SizeX="1", SizeY="1", ExtentX="256", ExtentY="256")  # -> simplify(Cells), Points
area_16 = Area(Geometry=rectangular.Cells)  # -> Area, flatten(Centroid)
point_2 = Point(Point(0, 0, 0))
curve_4 = Curve(flatten(rectangular.Cells))
scale_4 = Scale(Geometry=curve_4, Center=point_2, Factor=scale_factor)  # -> Geometry, Transform

point_3 = Point(Point(0, 0, 0.8))
xy_plane_3 = XYPlane(Origin=point_3)
mesh_plane = MeshPlane(Mesh=orianted_obstructions_mesh, Plane=xy_plane_3)
closed = Closed(Curve=mesh_plane)  # -> Closed, Periodic
cull_pattern_6 = CullPattern(List=mesh_plane, CullPattern=closed.Closed)
scale_5 = Scale(Geometry=cull_pattern_6, Center=point_2, Factor=scale_factor)  # -> Geometry, Transform
unit_z_4 = UnitZ(Factor=Slider(20, range=0..100))
move_3 = Move(Geometry=scale_5.Geometry, Motion=unit_z_4)  # -> Geometry, Transform
colour_rgb_9 = ColourRGB(Alpha=255, Red=0, Green="255", Blue=0)
create_gdi_fill_8 = CreateGdiFill(Colour=colour_rgb_9)
curve_5 = Curve(move_3.Geometry)
create_gdi_shape_8 = CreateGdiShape(Geometry=curve_5, Fill=create_gdi_fill_8)  # -> flatten(Shape)

surface_3 = Surface(move_3.Geometry)
custom_preview_3 = CustomPreview(Geometry=surface_3, Material=colour_rgb_9)

point_4 = Point(Point(-128, -128, -0.5))
rectangular_2 = Rectangular(Plane=point_4, SizeX="1", SizeY="1", ExtentX="256", ExtentY="256")  # -> simplify(Cells), Points
area_17 = Area(Geometry=rectangular_2.Cells)  # -> Area, flatten(Centroid)
unit_z_5 = UnitZ(Factor="900")
curve_6 = Curve(flatten(rectangular_2.Cells))
point_5 = Point(Point(0, 0, 0))
scale_6 = Scale(Geometry=curve_6, Center=point_5, Factor=scale_factor)  # -> Geometry, Transform

move_4 = Move(Geometry=area_17.Centroid, Motion=unit_z_5)  # -> Geometry, Transform
move_5 = Move(Geometry=area_16.Centroid, Motion=Vector(0, 0, 10))  # -> Geometry, Transform
mesh_ray = MeshRay(Mesh=orianted_obstructions_mesh, Point=move_4.Geometry, Direction=unit_z_2)  # -> Point, Hit
mesh_ray_2 = MeshRay(Mesh=orianted_obstructions_mesh, Point=move_5.Geometry, Direction=unit_z_3)  # -> Point, Hit
move_6 = Move(Geometry=boundary_surfaces, Motion=amplitude)  # -> Geometry, Transform
cull_pattern_7 = CullPattern(List=scale_6.Geometry, CullPattern=mesh_ray.Hit)
cull_pattern_8 = CullPattern(List=scale_4.Geometry, CullPattern=mesh_ray_2.Hit)

windowsillcrv_2 = Curve(move_6.Geometry)
color_window_2 = Colour(colour_rgb_7)
create_gdi_fill_9 = CreateGdiFill(Colour=color_window_2)
create_gdi_shape_9 = CreateGdiShape(Geometry=windowsillcrv_2, Fill=create_gdi_fill_9)  # -> flatten(EncodedWindow)

windowsillmesh_2 = Mesh(move_6.Geometry)
previewwindow_2 = CustomPreview(Geometry=windowsillmesh_2, Material=colour_rgb_7)

deconstruct_3 = Deconstruct(Point=mesh_ray.Point)  # -> XComponent, YComponent, ZComponent
number = Number(flatten(deconstruct_3.ZComponent))
remap_numbers_7 = RemapNumbers(Value=number, Source="0 to 200", Target="0 to 255")  # -> Mapped, Clipped
colour_rgb_10 = ColourRGB(Alpha=255, Red=0, Green=0, Blue=remap_numbers_7.Mapped)  # -> simplify(flatten(Colour))
curve_7 = Curve(cull_pattern_7)

deconstruct_4 = Deconstruct(Point=mesh_ray_2.Point)  # -> XComponent, YComponent, ZComponent
number_2 = Number(flatten(deconstruct_4.ZComponent))
remap_numbers_8 = RemapNumbers(Value=number_2, Source="0 to 50", Target="200 to 0")  # -> Mapped, Clipped
colour_rgb_11 = ColourRGB(Alpha=255, Red=0, Green=remap_numbers_8.Mapped, Blue=0)  # -> simplify(flatten(Colour))
curve_8 = Curve(cull_pattern_8)

cull_pattern_9 = CullPattern(List=colour_rgb_10, CullPattern=mesh_ray.Hit)
cull_pattern_10 = CullPattern(List=colour_rgb_11, CullPattern=mesh_ray_2.Hit)
merge_6 = Merge(Data1=flatten(create_gdi_shape_4), Data2=flatten(create_gdi_shape_9))

create_gdi_fill_10 = CreateGdiFill(Colour=cull_pattern_9)
create_gdi_shape_10 = CreateGdiShape(Geometry=curve_7, Fill=create_gdi_fill_10)  # -> flatten(Shape)

surface_4 = Surface(cull_pattern_7)
custom_preview_4 = CustomPreview(Geometry=surface_4, Material=cull_pattern_9)

create_gdi_fill_11 = CreateGdiFill(Colour=cull_pattern_10)
create_gdi_shape_11 = CreateGdiShape(Geometry=curve_8, Fill=create_gdi_fill_11)  # -> flatten(Shape)

surface_5 = Surface(cull_pattern_8)
custom_preview_5 = CustomPreview(Geometry=surface_5, Material=cull_pattern_10)

project_7 = Project(Geometry=picture_frame_curve_4, Plane=PlaneXY(0, 0, 0))  # -> Geometry, Transform
concatenate_16 = Concatenate(FragmentA=path_for_blue, FragmentC=naming_6, FragmentD=".png")
scale_factor_for_image_9 = Number(scale_factor_for_image_2)
draw_image_6 = DrawImage(
    Shapes=simplify(create_gdi_shape_10),
    Size=project_7.Geometry,
    Factor=scale_factor_for_image_9,
    Background=RGB(0, 0, 0),
    AntiAlias=False,
    FileLocation=simplify(concatenate_16))

merge_7 = Merge(Data1=flatten(create_gdi_shape_11), Data2=flatten(create_gdi_shape_8))

picture_frame_curve_8 = Curve(encoded_picture_frame_2)
project_8 = Project(Geometry=picture_frame_curve_8, Plane=PlaneXY(0, 0, 0))  # -> Geometry, Transform
concatenate_17 = Concatenate(FragmentA=path_for_alpha, FragmentC=naming_8, FragmentD=".png")
draw_image_7 = DrawImage(
    Shapes=simplify(merge_6),
    Size=project_8.Geometry,
    Factor=scale_factor_for_image_6,
    Background=colour_rgb_5,
    AntiAlias=False,
    FileLocation=simplify(concatenate_17))

project_9 = Project(Geometry=picture_frame_curve_6, Plane=PlaneXY(0, 0, 0))  # -> Geometry, Transform
concatenate_18 = Concatenate(FragmentA=path_for_green, FragmentC=naming_7, FragmentD=".png")
scale_factor_for_image_10 = Number(scale_factor_for_image_2)
draw_image_8 = DrawImage(
    Shapes=simplify(merge_7),
    Size=project_9.Geometry,
    Factor=scale_factor_for_image_10,
    Background=RGB(0, 0, 0),
    AntiAlias=False,
    FileLocation=simplify(concatenate_18))
